# Grasshopper definition machine builder.gh (Grasshopper 0.9.76)
# Copyright: Creative commons attribution share-a-like

# ---- group: Pinion axis inside cut
list = ValueList({"3mm Single-flute Up-cut": 0, "1/8\" Single-flute Up-cut": 1}, selected="3mm Single-flute Up-cut")

# ---- group: Pinion pre cut
list_2 = ValueList({"6mm Single-flute Up-cut": 0, "1/4\" Single-flute Up-cut": 1}, selected="6mm Single-flute Up-cut")

# ---- group: Pinion teeth cut
list_3 = ValueList({"2mm Single-flute Up-cut": 0}, selected="2mm Single-flute Up-cut")

# ---- group: Main material and rail pre cut
list_4 = ValueList({"6mm Single-flute Up-cut": 0, "1/4\" Single-flute Up-cut": 1}, selected="6mm Single-flute Up-cut")

# ---- group: Rack teeth cut
list_5 = ValueList({"3mm Single-flute Up-cut": 0, "1/8\" Single-flute Up-cut": 1}, selected="3mm Single-flute Up-cut")

# ---- group: DLP SLA work area
z_axis_length = Slider(60, range=20..1000)
build_platform_size_x = Slider(100, range=20..200)
build_platform_size_y = Slider(60, range=20..200)

# ----
merge = Merge(Data1="Plastic: ", Data2="0.6", Data3=" M2")
merge_2 = Merge(Data1="MDF: ", Data2="1.5", Data3=" M2")
join = TextJoin(Text=merge)
join_2 = TextJoin(Text=merge_2)
merge_3 = Merge(Data1=join_2, Data2=join, Data3="NEMA 17 motor: 4", Data4="Bolt M5: 24", Data5="Bolt M5: 24", Data6="Nut M5: 24")

# ---- group: Simple gantry
make_dual_z_axis = BooleanToggle(False)
motorize_z_axis1 = BooleanToggle(False)
motorize_z_axis2 = BooleanToggle(False)
motor_height = Slider(12, range=10..20)
make_vacuum_bed = BooleanToggle(True)
# Machine stats:
# Machine type:
# 
# Acutual Z axis travel:
# 
# Rigididity rating: 0.2
vaccum_tube_diameter = Slider(12, range=10..20)

# ---- group: Pinion pre cut
diameter = Slider(6, range=3..6.35)

# ---- group: Pinion axis inside cut
diameter_2 = Slider(3, range=3..4)

# ---- group: Pinion teeth cut
diameter_3 = Slider(2, range=2..4)

# ---- group: Rack teeth cut
diameter_4 = Slider(3, range=2..6.35)

# ---- group: Birds mouth diamond bit
diameter_5 = Slider(38, range=10..50)
upper_knife_length = Slider(12, range=10..40)
lower_knife_length = Slider(22, range=10..40)

# ---- group: Main material and rail pre cut
# My milling bits:
diameter_6 = Slider(6, range=3..6.35)

# ----
# Welcome to the machine builder.
# 
# A simple way of building custom machines
# with a large format CNC router.
# 
# 1; Specify your desired machine, materials and tools available
# 2: Simulate and verfify your machine
# 3: Generate g-code for cutting the various parts of the macine
# 4: Assemble, add end-effector, calibrate and use
# 1
# I want build this
# kind of machine:
# It should be able to
# make things this size:
list_6 = ValueList({"Single axis": 0, "Simple gantry": 1, "Delta platform": 2}, selected="Single axis")

# ---- group: Single axis
axis_length = Slider(320, range=20..1000)

# ---- group: Simple gantry work area
work_area_x = Slider(640, range=20..1000)
work_area_y = Slider(320, range=20..1000)
work_area_z = Slider(40, range=20..1000)

# ---- group: Delta platform work area
end_effector_plate_diameter = Slider(60, range=60..200)
work_area_diameter = Slider(300, range=20..1000)
arm_to_platform_angle = Slider(60, range=45..75)

# ----
motor_shaft_diamameter = Slider(5, range=3..15)
# I want to use this
# motor standard:
list_7 = ValueList({"NEMA 17": 0, "NEMA 23": 1, "NEMA 34": 2}, selected="NEMA 17")

# ---- group: Simple gantry bed surfacing bit
diameter_7 = Slider(10, range=10..20)

# ---- group: Vacuum bed hole drill
diameter_8 = Slider(3, range=1..6)

# ----
# I want it to glide with:
list_8 = ValueList({"Plain bearings, V-type": 0, "Skateboard bearing V-wheels": 1}, selected="Plain bearings, V-type")

# ---- group: Main construction material
# I want to use these materials:
list_9 = ValueList({"Valchromat / MDF": 0, "Plastic": 1, "Aluminum / Brass": 2}, selected="Valchromat / MDF")
thickness = Slider(12, range=10..20)

# ---- group: Rail, rack and pinion material
list_10 = ValueList({"Plastic": 0, "Aluminum / Brass": 1}, selected="Plastic")
thickness_2 = Slider(12, range=10..20)

# ----
# Bonus features:
join_rails_with_dowels_instead_of_m5_bol = BooleanToggle(True)  # "Join rails with dowels instead of M5 bolts"

# ---- group: BOM
# Bill of materials:
# ok lets verify this:
panel = Panel(merge_3)

# ----
rack_teeth_bit = Panel(diameter_4)
motor_shaft_diamameter_2 = Panel(motor_shaft_diamameter)
job_simulation_position = Slider(0, range=0..1)
list_11 = ValueList({"View machine in 3D": 0, "View machine in 2D - 1:1": 1, "View machine from end effector position": 2}, selected="View machine in 3D")
# 2
# I want to simulate this job:
job_to_simulate = Panel("Hello world")
list_12 = ValueList({"I'm rich, give me an efficient cut sheet for all the parts": 0, "I'm poor, give me part: 1": 1, "I'm poor, give me part: 2": 2, "I'm poor, give me part: 3": 3, "I'm poor, give me part: 4": 4, "I'm poor, give me part: 5": 5, "I'm poor, give me part: 6": 6, "I'm poor, give me part: 7": 7, "I'm poor, give me part: 8": 8}, selected="I'm rich, give me an efficient cut sheet for all the parts")
# 3
# Now i want to:
list_13 = ValueList({"View machine parts": 0, "Pre fabricate main frame parts": 1, "Pre fabricate rails, pinion and bearings": 2, "Cut pinion axis hole": 3, "Cut pinion teeth": 4, "Cut registration geometry for machine": 5, "Cut v-rail geometry": 6, "Cut rack geometry": 7, "Flatten gantry bed": 8, "Drill vacuum holes": 9, "Document this machine": 10}, selected="Pre fabricate main frame parts")
current_hold_down_g_code = Panel("M3 fest")
# I want to make this the manual way,
# give me the geometry:
current_part_main_cut_g_code = Panel("M3 fest")
# Speed multiplier?
# Milling bit for current job: 6mm single flute upcut
material_for_current_job = Panel("MDF 12mm")
# Instructions: Assmeble parts bla bla
minimum_distance_from_collet_to_bit_tip = Panel("5mm")  # "Minimum distance from collet to bit tip for current job"

# ---- group: Right clik and choose "Bake"
selected_machine_parts_for_export = Geometry()

# ----
motor_type = Panel(list_7)
motor_mount_hole_diameters = Panel("""3
5
6.5""")
pinion_axis_inside_bit = Panel(diameter_2)
motor_mount_hole_spacings = Panel("""31
47.14
69.6""")
hole_size_multiplier = Panel("1.2")
main_material_bit = Panel(diameter_6)
pinion_pre_cut_bit = Panel(diameter)
main_material_thickness = Panel(thickness)
rail_rack_and_pinion_material_thickness = Panel(thickness_2)
multiplication = Multiplication(A=motor_mount_hole_diameters, B=hole_size_multiplier)
item = ListItem(List=multiplication, Index=motor_type, Wrap=True)
item_2 = ListItem(List=motor_mount_hole_spacings, Index=motor_type, Wrap=True)
rail_flat_mid_section_heigth = Panel("1")
rack_and_pinion_tooth_overlap_reduction = Panel("1")  # "Rack and pinion tooth overlap reduction distance"
material_leftover_thickness_in_pinion_po = Panel("0.5")  # "Material leftover thickness in pinion pocket"
rack_and_pinion_tooth_height = Panel("6")
rail_to_carriage_safety_distance = Panel("2.5")
wedge_or_bolt_spacing = Panel("50")
v_rail_to_attachment_bolt_margin = Panel("5")
# Advanced settings
axis_width = Panel("100")
carriage_lenght = Panel("100")
pinion_to_pocket_wall_margin = Panel("2")
pinion_edge_screw_edge_margin = Panel("5")
nut_width_flat_side_to_flat_side = Panel("5")
wedge_width_to_material_thickness_ratio = Panel("1.5")
number_of_pinion_teeth = Panel("10")
number_of_layers_beneath_rack_and_rail_l = Panel("2")  # "Number of layers beneath rack and rail layer"
spacer_diameter_inc_margin = Panel("18")
additional_axis_margin = Panel("2")
rack_mill_margin = Panel("0.1")

rack_and_pinion_tooth_overlap_reduction_2 = Panel(rack_and_pinion_tooth_overlap_reduction)  # "Rack and pinion tooth overlap reduction distance"
material_leftover_thickness_in_pinion_po_2 = Panel(material_leftover_thickness_in_pinion_po)  # "Material leftover thickness in pinion pocket"
rail_to_carriage_safety_distance_2 = Panel(rail_to_carriage_safety_distance)
addition = Addition(A=rack_and_pinion_tooth_overlap_reduction_2, B=material_leftover_thickness_in_pinion_po_2)
larger = LargerThan(FirstNumber=addition, SecondNumber=rail_to_carriage_safety_distance_2)  # -> LargerThan, OrEqualTo
inssuficent_sapce_between_pinion_and_car = Panel(larger.LargerThan)  # "Inssuficent sapce between pinion and carriage"

# ---- group: Make rack and pinion
# Optimize rack and pinion maker. Make offset, then copy. No join
axis_length_2 = Panel(axis_length)
additional_axis_margin_2 = Panel(additional_axis_margin)
rack_teeth_bit_3 = Panel(diameter_4)
rack_mill_margin_2 = Panel(rack_mill_margin)
number_of_pinion_teeth_2 = Panel(number_of_pinion_teeth)
motor_shaft_diamameter_3 = Panel(motor_shaft_diamameter)
addition_2 = Addition(A=rack_teeth_bit_3, B=rack_mill_margin_2)
multiplication_2 = Multiplication(A=additional_axis_margin_2, B="2")
addition_3 = Addition(A=axis_length_2, B=multiplication_2)
actual_axis_lenght = Panel(addition_3)
roller_rack_and_pinion_maker = RollerRackAndPinionMaker(
    rack_length=actual_axis_lenght,
    milling_bit_diameter=addition_2,
    number_of_pinion_teeth=number_of_pinion_teeth_2,
    motor_shaft_diameter=motor_shaft_diamameter_3)  # -> rack_teeth_4, rack_edge_2, pinion_teeth_4, pinion_center_hole_3, pinion_edge_3, pinion_movement_preview_3, distance_covered_per_step_5, maxium_pinion_milling_bit_diamter_4

# ----
step_resolution = Panel(roller_rack_and_pinion_maker.distance_covered_per_step_5)
rack_teeth = Curve(roller_rack_and_pinion_maker.rack_teeth_4)
pinion_movement_preview = Curve(roller_rack_and_pinion_maker.pinion_movement_preview_3)
pinion_center_hole = Curve(roller_rack_and_pinion_maker.pinion_center_hole_3)
pinion_teeth = Curve(roller_rack_and_pinion_maker.pinion_teeth_4)

# ---- group: Check pinion teeth milling bit
max_pinion_diamter = Panel(roller_rack_and_pinion_maker.maxium_pinion_milling_bit_diamter_4)
rack_mill_margin_3 = Panel(rack_mill_margin_2)
xy = XYPlane(Origin=Point(0, 0, 0))
pinion_teeth_bit_diameter = Panel(diameter_3)
warning_plane = Plane(xy)
subtraction = Subtraction(A=max_pinion_diamter, B=rack_mill_margin_3)
smaller = SmallerThan(FirstNumber=subtraction, SecondNumber=pinion_teeth_bit_diameter)  # -> SmallerThan, OrEqualTo
panel_2 = Panel("""WARNING:
Pinion teeth milling bit
diameter to large""")
filter = StreamFilter(Gate=smaller.OrEqualTo, Stream1=warning_plane)
tag = TextTag3D(Location=filter, Text=panel_2, Size="100", Colour=ColourSwatch(SwatchColor=RGB(255, 0, 102)), Justification=7)

# ----
bird_bit_lower_knife_lenght = Panel(lower_knife_length)
bird_bit_upper_knife_lenght = Panel(upper_knife_length)
bird_bit_diameter = Panel(diameter_5)
multiplication_3 = Multiplication(A=bird_bit_diameter, B="0.5")
pt = ConstructPoint(XCoordinate=0, YCoordinate=multiplication_3, ZCoordinate=0)
pt_2 = ConstructPoint(XCoordinate=0, YCoordinate=multiplication_3, ZCoordinate=bird_bit_upper_knife_lenght)
pt_3 = ConstructPoint(XCoordinate=0, YCoordinate=multiplication_3, ZCoordinate=bird_bit_lower_knife_lenght)
yz = YZPlane(Origin=pt)
rotate = Rotate(Geometry=pt_2, Angle=degrees("45"), Plane=yz)  # -> Geometry, Transform
rotate_2 = Rotate(Geometry=pt_3, Angle=degrees("135"), Plane=yz)  # -> Geometry, Transform
pdecon = Deconstruct(Point=rotate_2.Geometry)  # -> XComponent, YComponent, ZComponent
Z = UnitZ(Factor="20")
pt_4 = ConstructPoint(XCoordinate=0, YCoordinate=0, ZCoordinate=0)
pt_5 = ConstructPoint(XCoordinate=0, YCoordinate=0, ZCoordinate=pdecon.ZComponent)
move = Move(Geometry=rotate.Geometry, Motion=Z)  # -> Geometry, Transform
ln = Line(StartPoint=pt, EndPoint=rotate.Geometry)
ln_2 = Line(StartPoint=pt, EndPoint=rotate_2.Geometry)
ln_3 = Line(StartPoint=pt_5, EndPoint=pt_4)
ln_4 = Line(StartPoint=rotate_2.Geometry, EndPoint=pt_5)
ln_5 = Line(StartPoint=move.Geometry, EndPoint=rotate.Geometry)
join_3 = JoinCurves(Curves=[ln_5, ln, ln_2, ln_4], Preserve=False)
revsrf = Revolution(Curve=join_3, Axis=ln_3, Domain=Domain(0, 6.283185307))
bird_beak_model = Brep(revsrf)
center_point = Point(pt_5)
upper_line = Line(ln)
lower_line = Line(ln_2)

# ---- group: Make rack and pinion pocket depths
material_leftover_thickness_in_pinion_po_3 = Panel(material_leftover_thickness_in_pinion_po)  # "Material leftover thickness in pinion pocket"
rack_and_pinion_tooth_height_2 = Panel(rack_and_pinion_tooth_height)
rail_rack_and_pinion_material_thickness_2 = Panel(thickness_2)
subtraction_2 = Subtraction(A=rail_rack_and_pinion_material_thickness_2, B=material_leftover_thickness_in_pinion_po_3)
subtraction_3 = Subtraction(A=subtraction_2, B=rack_and_pinion_tooth_height_2)
rack_pocket_depth = Panel(subtraction_3)
pinion_pocket_depth = Panel(subtraction_2)

# ---- group: Make rack top pocket
pinion_edge_screw_edge_margin_2 = Panel(pinion_edge_screw_edge_margin)
additional_axis_margin_3 = Panel(additional_axis_margin)
rack_teeth_2 = Curve(roller_rack_and_pinion_maker.rack_teeth_4)
bbox = BoundingBox(Content=rack_teeth_2, Plane=PlaneXY(0, 0, 0), UnionBox=True)  # -> Box, Box_2
edges = BrepEdges(Brep=bbox.Box)  # -> Naked, Interior, NonManifold
item_3 = ListItem(List=edges.Naked, Index="2", Wrap=True)
item_4 = ListItem(List=edges.Naked, Index=0, Wrap=True)
flip = FlipCurve(Curve=item_3)  # -> Curve, Flag
neg = Negative(Value=pinion_edge_screw_edge_margin_2)
rack_tooth_edge = Curve(flip.Curve)
rack_outer_edge = Curve(item_4)
Y = UnitY(Factor=neg)
Y_2 = UnitY(Factor="1")
ext = ExtendCurve(Curve=rack_tooth_edge, Type=0, Start=additional_axis_margin_3, End=additional_axis_margin_3)
ext_2 = ExtendCurve(Curve=rack_outer_edge, Type=0, Start=additional_axis_margin_3, End=additional_axis_margin_3)
move_2 = Move(Geometry=ext_2, Motion=Y)  # -> Geometry, Transform
move_3 = Move(Geometry=ext, Motion=Y_2)  # -> Geometry, Transform
end = EndPoints(Curve=move_3.Geometry)  # -> Start, End
end_2 = EndPoints(Curve=move_2.Geometry)  # -> Start, End
ln_6 = Line(StartPoint=end.End, EndPoint=end_2.End)
ln_7 = Line(StartPoint=end.Start, EndPoint=end_2.Start)
join_4 = JoinCurves(Curves=flatten([move_3.Geometry, ln_7, ln_6, move_2.Geometry]), Preserve=False)
rack_pocket_depth_2 = Panel(rack_pocket_depth)
rack_pocket = Curve(join_4)

# ---- group: Make pinion pocket
pinion_to_pocket_wall_margin_2 = Panel(pinion_to_pocket_wall_margin)
pinion_edge = Curve(roller_rack_and_pinion_maker.pinion_edge_3)
bbox_2 = BoundingBox(Content=pinion_edge, Plane=PlaneXY(0, 0, 0))  # -> Box, Box_2
dim = Dimensions(Surface=flatten(bbox_2.Box))  # -> UDimension, VDimension
pinion_width = Panel(dim.UDimension)
rack_tooth_edge_2 = Curve(ext)
multiplication_4 = Multiplication(A=pinion_width, B="0.5")
addition_4 = Addition(A=multiplication_4, B=pinion_to_pocket_wall_margin_2)
end_3 = EndPoints(Curve=rack_tooth_edge_2)  # -> Start, End
pdecon_2 = Deconstruct(Point=end_3.Start)  # -> XComponent, YComponent, ZComponent
pdecon_3 = Deconstruct(Point=end_3.End)  # -> XComponent, YComponent, ZComponent
pt_6 = ConstructPoint(XCoordinate=pdecon_2.XComponent, YCoordinate=addition_4, ZCoordinate=0)
pt_7 = ConstructPoint(XCoordinate=pdecon_3.XComponent, YCoordinate=addition_4, ZCoordinate=0)
ln_8 = Line(StartPoint=pt_6, EndPoint=pt_7)
end_4 = EndPoints(Curve=ln_8)  # -> Start, End
end_5 = EndPoints(Curve=rack_tooth_edge_2)  # -> Start, End
ln_9 = Line(StartPoint=end_4.End, EndPoint=end_5.End)
ln_10 = Line(StartPoint=end_4.Start, EndPoint=end_5.Start)
join_5 = JoinCurves(Curves=flatten([ln_10, ln_9, rack_tooth_edge_2, ln_8]), Preserve=False)
pinion_pocket_depth_2 = Panel(pinion_pocket_depth)
# make pocket depths
pinion_pocket = Curve(join_5)

# ----
bird_bit_diameter_2 = Panel(bird_bit_diameter)
safe_x_y_bird_bit = Panel("10")
multiplication_5 = Multiplication(A=bird_bit_diameter_2, B=".5")
addition_5 = Addition(A=multiplication_5, B=safe_x_y_bird_bit)
xy_2 = XYPlane(Origin=Point(0, 0, 0))
yz_2 = YZPlane(Origin=Point(0, 0, 0))
xz = XZPlane(Origin=Point(0, 0, 0))

# ---- group: Find axis edges and width
axis_width_2 = Panel(axis_width)
pinion_edge_screw_edge_margin_3 = Panel(pinion_edge_screw_edge_margin_2)
wedge_width_to_material_thickness_ratio_2 = Panel(wedge_width_to_material_thickness_ratio)
actual_axis_lenght_2 = Panel(actual_axis_lenght)
carriage_lenght_2 = Panel(carriage_lenght)
v_rail_to_attachment_bolt_margin_2 = Panel(v_rail_to_attachment_bolt_margin)
spacer_diamter = Panel(spacer_diameter_inc_margin)
pinion_width_2 = Panel(dim.UDimension)
join_rails_with_dowels_instead_of_m5_bol_2 = Panel(join_rails_with_dowels_instead_of_m5_bol)  # "Join rails with dowels instead of M5 bolts"
additional_axis_margin_4 = Panel(additional_axis_margin)
main_material_thickness_2 = Panel(thickness)
multiplication_6 = Multiplication(A=wedge_width_to_material_thickness_ratio_2, B=main_material_thickness_2)
multiplication_7 = Multiplication(A=pinion_width_2, B="0.5")
top_wedge_hole_width = Panel(multiplication_6)
addition_6 = Addition(A=multiplication_7, B=pinion_edge_screw_edge_margin_3)
minium_distance_to_start_bolt_placing = Panel(addition_6)
filter_2 = StreamFilter(Gate=join_rails_with_dowels_instead_of_m5_bol_2, Stream0=spacer_diamter, Stream1=top_wedge_hole_width)
top_hole_width = Panel(filter_2)
v_rail_to_attachment_bolt_margin_3 = Panel(v_rail_to_attachment_bolt_margin_2)
multiplication_8 = Multiplication(A=top_hole_width, B="0.5")
addition_7 = Addition(A=multiplication_8, B=v_rail_to_attachment_bolt_margin_3)
bolt_hole_pluss_margin_radus = Panel(addition_7)
addition_8 = Addition(A=minium_distance_to_start_bolt_placing, B=bolt_hole_pluss_margin_radus)
attachment_bolt_center_line_distance = Panel(addition_8)
bolt_hole_pluss_margin_radus_2 = Panel(addition_7)
desired_axis_width = Panel(axis_width_2)
multiplication_9 = Multiplication(A=desired_axis_width, B="0.5")
addition_9 = Addition(A=attachment_bolt_center_line_distance, B=addition_7, C=v_rail_to_attachment_bolt_margin_3)
multiplication_10 = Multiplication(A=addition_9, B="2")
subtraction_4 = Subtraction(A=multiplication_9, B=bolt_hole_pluss_margin_radus_2)
minimum_axis_width = Panel(multiplication_10)
desired_axis_width_2 = Panel(axis_width_2)
subtraction_5 = Subtraction(A=subtraction_4, B=v_rail_to_attachment_bolt_margin_3)
desired_attachment_bolt_center_line_dist = Panel(subtraction_5)  # "Desired attachment bolt center line distance"
smaller_2 = SmallerThan(FirstNumber=minimum_axis_width, SecondNumber=desired_axis_width_2)  # -> SmallerThan, OrEqualTo
filter_3 = StreamFilter(Gate=smaller_2.SmallerThan, Stream0=minimum_axis_width, Stream1=desired_axis_width_2)
axis_width_3 = Panel(filter_3)
filter_4 = StreamFilter(
    Gate=smaller_2.SmallerThan,
    Stream0=attachment_bolt_center_line_distance,
    Stream1=desired_attachment_bolt_center_line_dist)
attachment_bolt_center_line_distance_2 = Panel(filter_4)
actual_axis_lenght_3 = Panel(actual_axis_lenght_2)
multiplication_11 = Multiplication(A=axis_width_3, B="0.5")
carriage_lenght_3 = Panel(carriage_lenght_2)
additional_axis_margin_5 = Panel(additional_axis_margin_4)
pt_8 = ConstructPoint(XCoordinate=0, YCoordinate=attachment_bolt_center_line_distance_2, ZCoordinate=0)
pt_9 = ConstructPoint(XCoordinate=actual_axis_lenght_3, YCoordinate=attachment_bolt_center_line_distance_2, ZCoordinate=0)
pt_10 = ConstructPoint(XCoordinate=0, YCoordinate=multiplication_11, ZCoordinate=0)
pt_11 = ConstructPoint(XCoordinate=actual_axis_lenght_3, YCoordinate=multiplication_11, ZCoordinate=0)
ln_11 = Line(StartPoint=pt_8, EndPoint=pt_9)
multiplication_12 = Multiplication(A=carriage_lenght_3, B="0.5")
ln_12 = Line(StartPoint=pt_10, EndPoint=pt_11)
addition_10 = Addition(A=multiplication_12, B=additional_axis_margin_5)
ext_3 = ExtendCurve(Curve=ln_11, Type=0, Start=addition_10, End=addition_10)
ext_4 = ExtendCurve(Curve=ln_12, Type=0, Start=addition_10, End=addition_10)
axis_width_4 = Panel(axis_width_3)
bolt_placement_axis = Curve(ext_3)
axis_edge = Curve(ext_4)

# ----
len = Length(Curve=ext_4)

# ---- group: Find axis edges and width (continued)
actual_axis_length = Panel(len)

# ----
rail_to_carriage_safety_distance_3 = Panel(rail_to_carriage_safety_distance)
bird_bit_upper_line = Line(upper_line)
bird_bit_center_point = Point(center_point)
rail_rack_and_pinion_material_thickness_3 = Panel(thickness_2)
rail_flat_mid_section_heigth_2 = Panel(rail_flat_mid_section_heigth)
bird_bit_lower_line = Line(lower_line)
xz_2 = XZPlane(Origin=Point(0, 0, 0))
axis_edge_2 = Curve(axis_edge)
mirror = Mirror(Geometry=axis_edge_2, Plane=xz_2)  # -> Geometry, Transform
end_6 = EndPoints(Curve=mirror.Geometry)  # -> Start, End
subtraction_6 = Subtraction(A=rail_rack_and_pinion_material_thickness_3, B=rail_to_carriage_safety_distance_3)
multiplication_13 = Multiplication(A=rail_flat_mid_section_heigth_2, B="0.5")
multiplication_14 = Multiplication(A=subtraction_6, B="0.5")
v_rail_height = Panel(subtraction_6)
v_rail_center_depth = Panel(multiplication_14)
rail_to_carriege_safety_distance = Panel(rail_to_carriage_safety_distance_3)
subtraction_7 = Subtraction(A=v_rail_center_depth, B=multiplication_13)
addition_11 = Addition(A=v_rail_center_depth, B=multiplication_13)
neg_2 = Negative(Value=rail_to_carriege_safety_distance)
neg_3 = Negative(Value=rail_to_carriege_safety_distance)
neg_4 = Negative(Value=subtraction_7)
neg_5 = Negative(Value=v_rail_height)
neg_6 = Negative(Value=addition_11)
pt_12 = Point(end_6.Start)
Y_3 = UnitY(Factor=subtraction_7)
Z_2 = UnitZ(Factor=neg_2)
Y_4 = UnitY(Factor=subtraction_7)
Z_3 = UnitZ(Factor=neg_4)
Y_5 = UnitY(Factor=neg_3)
Z_4 = UnitZ(Factor=neg_5)
Z_5 = UnitZ(Factor=neg_6)
move_4 = Move(Geometry=pt_12, Motion=Y_3)  # -> Geometry, Transform
move_5 = Move(Geometry=pt_12, Motion=Z_3)  # -> Geometry, Transform
move_6 = Move(Geometry=pt_12, Motion=Y_4)  # -> Geometry, Transform
move_7 = Move(Geometry=pt_12, Motion=Z_5)  # -> Geometry, Transform
move_8 = Move(Geometry=move_4.Geometry, Motion=Z_4)  # -> Geometry, Transform
rail_lowest_point = Point(move_8.Geometry)
move_9 = Move(Geometry=rail_lowest_point, Motion=Z_2)  # -> Geometry, Transform
move_10 = Move(Geometry=move_9.Geometry, Motion=Y_5)  # -> Geometry, Transform
ln_13 = Line(StartPoint=move_6.Geometry, EndPoint=move_5.Geometry)
ln_14 = Line(StartPoint=rail_lowest_point, EndPoint=move_10.Geometry)
ln_15 = Line(StartPoint=move_8.Geometry, EndPoint=move_7.Geometry)
ln_16 = Line(StartPoint=move_5.Geometry, EndPoint=move_7.Geometry)
v_rail_upper_line = Curve(ln_13)
bird_bit_center_point_2 = Point(bird_bit_center_point)
bird_bit_lower_line_2 = Line(bird_bit_lower_line)
bird_bit_center_point_3 = Point(bird_bit_center_point)
bird_beak_model_2 = Brep(bird_beak_model)
bird_bit_upper_line_2 = Line(bird_bit_upper_line)
v_rail_mid_section = Curve(ln_16)
v_rail_lower_line = Curve(ln_15)
v_rail_rest_line = Curve(ln_14)
bird_beak_model_3 = Brep(bird_beak_model)
len_2 = Length(Curve=bird_bit_lower_line_2)
eval = EvaluateLength(Curve=bird_bit_lower_line_2, Length="0.5", Normalized=True)  # -> Point, Tangent, Parameter
eval_2 = EvaluateLength(Curve=v_rail_upper_line, Length="0.5", Normalized=True)  # -> Point, Tangent, Parameter
len_3 = Length(Curve=v_rail_upper_line)
eval_3 = EvaluateLength(Curve=v_rail_lower_line, Length="0", Normalized=True)  # -> Point, Tangent, Parameter
len_4 = Length(Curve=v_rail_lower_line)
eval_4 = EvaluateLength(Curve=bird_bit_upper_line_2, Length="0", Normalized=True)  # -> Point, Tangent, Parameter
len_5 = Length(Curve=bird_bit_upper_line_2)
v_rail_upper_line_2 = Curve(v_rail_upper_line)
v_rail_mid_section_2 = Curve(v_rail_mid_section)
v_rail_rest_line_2 = Curve(v_rail_rest_line)
v_rail_lower_line_2 = Curve(v_rail_lower_line)
yz_3 = YZPlane(Origin=eval.Point)
yz_4 = YZPlane(Origin=eval_2.Point)
yz_5 = YZPlane(Origin=eval_3.Point)
yz_6 = YZPlane(Origin=eval_4.Point)
merge_4 = Merge(Data1=v_rail_upper_line_2, Data2=v_rail_mid_section_2, Data3=v_rail_lower_line_2, Data4=v_rail_rest_line_2)
orient = Orient(Geometry=bird_bit_center_point_2, Source=yz_3, Target=yz_4)  # -> Geometry, Transform
orient_2 = Orient(Geometry=bird_bit_center_point_3, Source=yz_6, Target=yz_5)  # -> Geometry, Transform
orient_3 = Orient(Geometry=bird_beak_model_2, Source=yz_3, Target=yz_4)  # -> Geometry, Transform
orient_4 = Orient(Geometry=bird_beak_model_3, Source=yz_6, Target=yz_5)  # -> Geometry, Transform
join_6 = JoinCurves(Curves=merge_4, Preserve=False)
end_point_upper_rail_path = Point(orient.Geometry)
end_point_lower_rail_path = Point(orient_2.Geometry)
rail_lowest_point_2 = Point(move_10.Geometry)
rail_profile = Curve(join_6)

# ---- group: Make axis outline
axis_edge_3 = Curve(axis_edge)
xz_3 = XZPlane(Origin=Point(0, 0, 0))
rail_rack_and_pinion_material_thickness_4 = Panel(thickness_2)
mirror_2 = Mirror(Geometry=axis_edge_3, Plane=xz_3)  # -> Geometry, Transform
end_7 = EndPoints(Curve=axis_edge_3)  # -> Start, End
end_8 = EndPoints(Curve=mirror_2.Geometry)  # -> Start, End
ln_17 = Line(StartPoint=end_7.Start, EndPoint=end_8.Start)
ln_18 = Line(StartPoint=end_7.End, EndPoint=end_8.End)
neg_7 = Negative(Value=rail_rack_and_pinion_material_thickness_4)
join_7 = JoinCurves(Curves=[ln_17, ln_18, axis_edge_3, mirror_2.Geometry], Preserve=False)
Z_6 = UnitZ(Factor=neg_7)
move_11 = Move(Geometry=join_7, Motion=Z_6)  # -> Geometry, Transform; disabled
axis_top_layer_outline = Curve(join_7)

# ----
wedge_or_bolt_spacing_2 = Panel(wedge_or_bolt_spacing)
wedge_width_to_material_thickness_ratio_3 = Panel(wedge_width_to_material_thickness_ratio)
join_rails_with_dowels_instead_of_m5_bol_3 = Panel(join_rails_with_dowels_instead_of_m5_bol)  # "Join rails with dowels instead of M5 bolts"
spacer_diamter_2 = Panel(spacer_diameter_inc_margin)
main_material_thickness_3 = Panel(thickness)
bolt_placement_axis_2 = Curve(bolt_placement_axis)
multiplication_15 = Multiplication(A=wedge_width_to_material_thickness_ratio_3, B=main_material_thickness_3)
top_wedge_hole_width_2 = Panel(multiplication_15)
filter_5 = StreamFilter(Gate=join_rails_with_dowels_instead_of_m5_bol_3, Stream0=spacer_diamter_2, Stream1=top_wedge_hole_width_2)
hole_width = Panel(filter_5)
bolt_placement_axis_3 = Curve(bolt_placement_axis_2)
len_6 = Length(Curve=bolt_placement_axis_3)
subtraction_8 = Subtraction(A=len_6, B=hole_width)
merge_5 = Merge(Data1=hole_width, Data2=subtraction_8)
eval_5 = EvaluateLength(Curve=bolt_placement_axis_3, Length=merge_5, Normalized=Toggle(False))  # -> Point, Tangent, Parameter
shatter = Shatter(Curve=bolt_placement_axis_3, Parameters=eval_5.Parameter)
wedge_or_bolt_spacing_3 = Panel(wedge_or_bolt_spacing_2)
item_5 = ListItem(List=shatter, Index="1", Wrap=True)
divide_curve_even_lenght = DivideCurveEvenLenght(crv=item_5, B=wedge_or_bolt_spacing_3)
xz_4 = XZPlane(Origin=Point(0, 0, 0))
mirror_3 = Mirror(Geometry=divide_curve_even_lenght, Plane=xz_4)  # -> Geometry, Transform
xy_3 = XYPlane(Origin=[divide_curve_even_lenght, mirror_3.Geometry])
# make hold down inside pinion pocket?
hole_planes_top_layer = Plane(xy_3)

# ---- group: Make lower axis layer outline and brep
number_of_layers_beneath_rack_and_rail_l_2 = Panel(number_of_layers_beneath_rack_and_rail_l)  # "Number of layers beneath rack and rail layer"
main_material_thickness_4 = Panel(thickness)
rail_rack_and_pinion_material_thickness_5 = Panel(thickness_2)
actual_axis_length_2 = Panel(actual_axis_length)
rail_lowest_point_3 = Point(rail_lowest_point_2)
series = Series(Start=0, Step=main_material_thickness_4, Count=number_of_layers_beneath_rack_and_rail_l_2)
pdecon_4 = Deconstruct(Point=rail_lowest_point_3)  # -> XComponent, YComponent, ZComponent
neg_8 = Negative(Value=rail_rack_and_pinion_material_thickness_5)
xz_5 = XZPlane(Origin=Point(0, 0, 0))
neg_9 = Negative(Value=series)
pt_13 = ConstructPoint(XCoordinate=pdecon_4.XComponent, YCoordinate=pdecon_4.YComponent, ZCoordinate=neg_8)
Z_7 = UnitZ(Factor=neg_9)
mirror_4 = Mirror(Geometry=pt_13, Plane=xz_5)  # -> Geometry, Transform
X = UnitX(Factor=actual_axis_length_2)
xy_4 = XYPlane(Origin=pt_13)
move_12 = Move(Geometry=mirror_4.Geometry, Motion=X)  # -> Geometry, Transform
neg_10 = Negative(Value=main_material_thickness_4)
# Make hex nut pockets inside lowest layer for easy atachment?
rec_2pt = Rectangle2Pt(Plane=xy_4, PointA=pt_13, PointB=move_12.Geometry, Radius=0)  # -> Rectangle, Length
Z_8 = UnitZ(Factor=neg_10)
extr = Extrude(Base=rec_2pt.Rectangle, Direction=Z_8)
cap = CapHoles(Brep=extr)
move_13 = Move(Geometry=cap, Motion=Z_7)  # -> Geometry, Transform
lower_parts_corner_plane = Plane(xy_4)
axis_lower_layer_outline = Curve(rec_2pt.Rectangle)
axis_lower_layers_brep = Brep(move_13.Geometry)

# ---- group: Make axis top layer 3D model
actual_axis_length_3 = Panel(actual_axis_length)
pinion_pocket_depth_3 = Panel(pinion_pocket_depth_2)
rack_pocket_depth_3 = Panel(rack_pocket_depth_2)
pinion_pocket_2 = Curve(pinion_pocket)
rack_pocket_2 = Curve(rack_pocket)
rail_profile_2 = Curve(rail_profile)
xz_6 = XZPlane(Origin=Point(0, 0, 0))
neg_11 = Negative(Value=rack_pocket_depth_3)
neg_12 = Negative(Value=pinion_pocket_depth_3)
mirror_5 = Mirror(Geometry=rail_profile_2, Plane=xz_6)  # -> Geometry, Transform
Z_9 = UnitZ(Factor=neg_11)
Z_10 = UnitZ(Factor=neg_12)
end_9 = EndPoints(Curve=rail_profile_2)  # -> Start, End
end_10 = EndPoints(Curve=mirror_5.Geometry)  # -> Start, End
extr_2 = Extrude(Base=rack_pocket_2, Direction=Z_9)
extr_3 = Extrude(Base=pinion_pocket_2, Direction=Z_10)
cap_2 = CapHoles(Brep=extr_2)
cap_3 = CapHoles(Brep=extr_3)
ln_19 = Line(StartPoint=end_9.End, EndPoint=end_10.End)
ln_20 = Line(StartPoint=end_9.Start, EndPoint=end_10.Start)
join_8 = JoinCurves(Curves=[ln_20, ln_19, mirror_5.Geometry, rail_profile_2], Preserve=False)
X_2 = UnitX(Factor=actual_axis_length_3)
extr_4 = Extrude(Base=join_8, Direction=X_2)
cap_4 = CapHoles(Brep=extr_4)
sdiff = SolidDifference(BrepsA=cap_4, BrepsB=cap_3)
sdiff_2 = SolidDifference(BrepsA=sdiff, BrepsB=cap_2)
axis_top_layer_brep = Brep(sdiff_2)

# ----
actual_axis_length_4 = Panel(actual_axis_length)
end_point_lower_rail_path_2 = Point(end_point_lower_rail_path)
end_point_upper_rail_path_2 = Point(end_point_upper_rail_path)
X_3 = UnitX(Factor=actual_axis_length_4)
move_14 = Move(Geometry=end_point_upper_rail_path_2, Motion=X_3)  # -> Geometry, Transform
ln_21 = Line(StartPoint=move_14.Geometry, EndPoint=end_point_upper_rail_path_2)
ext_5 = ExtendCurve(Curve=ln_21, Type=0, Start=addition_5, End=addition_5)
redpline = Reduce(Polyline=ext_5, Tolerance=1)  # -> Polyline, Reduction
mirror_6 = Mirror(Geometry=redpline.Polyline, Plane=xz)  # -> Geometry, Transform
flip_2 = FlipCurve(Curve=mirror_6.Geometry)  # -> Curve, Flag
merge_6 = Merge(Data1=redpline.Polyline, Data2=flip_2.Curve)
crv = Curve(merge_6)

# ==== cluster RollerRackAndPinionMaker: Makes rack and pinion gemetry suitable for 3 axis CNC milling. Has low backlash, but is vulnerable to contamination. More options inside component.
number_of_pinion_teeth = ClusterInput()
milling_bit_diameter = ClusterInput()
motor_shaft_diameter = ClusterInput()
rack_length = ClusterInput()

# ---- group: Smaller amount of teeth gives higher resolution and more torque
number_of_pinion_teeth_2 = Panel("10")
number_of_pinion_teeth_3 = Number(number_of_pinion_teeth)
null = NullItem(Item=number_of_pinion_teeth_3)  # -> NullFlags, InvalidFlags, Description
filter = StreamFilter(Gate=null.NullFlags, Stream0=number_of_pinion_teeth_3, Stream1=number_of_pinion_teeth_2)
number_of_pinion_teeth_4 = Panel(filter)

# ---- group: Determines the tooth sppacing, some margin recommended
milling_bit_diameter_2 = Panel("3.1")
milling_bit_diameter_3 = Number(milling_bit_diameter)
null_2 = NullItem(Item=milling_bit_diameter_3)  # -> NullFlags, InvalidFlags, Description
filter_2 = StreamFilter(Gate=null_2.NullFlags, Stream0=milling_bit_diameter_3, Stream1=milling_bit_diameter_2)
milling_bit_diameter_4 = Panel(filter_2)

# ---- group: Determines the travel distance of pinion
rack_length_2 = Panel("200")
rack_length_3 = Number(rack_length)
# default config for 2mm pinion milling and 3mm rack milling: bit diamter: 3.1
# margin factor: -0.14
# number of pinion teeth: 10
# fillet ratio: 0.15
null_3 = NullItem(Item=rack_length_3)  # -> NullFlags, InvalidFlags, Description
filter_3 = StreamFilter(Gate=null_3.NullFlags, Stream0=rack_length_3, Stream1=rack_length_2)
rack_length_4 = Panel(filter_3)

# ---- group: The shaft diameter of the motor driving the pinion
motor_shaft_diameter_2 = Panel("5")
motor_shaft_diameter_3 = Number(motor_shaft_diameter)
null_4 = NullItem(Item=motor_shaft_diameter_3)  # -> NullFlags, InvalidFlags, Description
filter_4 = StreamFilter(Gate=null_4.NullFlags, Stream0=motor_shaft_diameter_3, Stream1=motor_shaft_diameter_2)
motor_shaft_diameter_4 = Panel(filter_4)

# ----
preview_position_0_1 = ClusterInput()
preview_position = Slider(0.25, range=0..1)

# ---- group: Low fillet ratio gives smoother motion, but makes a less robust pinion
tooth_fillet_ratio = Slider(0.15, range=0..1)
tooth_fillet_ratio_2 = Panel(tooth_fillet_ratio)

# ---- group: Controlls pinion tooth blending
rounding_factor_pinion_outside = Slider(20, range=0..100)
rounding_factor_pinion_inside = Slider(70, range=0..100)

# ---- group: Start numbers to help calculte pinion tooth path through rack
number_of_curve_sample_points = Slider(20, range=0..1000)
sample_tooth_position = Panel("0.26")

# ---- group: Lower number gives more clearene between rack tooth and pinion valley
pinion_corner_tolerance_factor = Panel("15")

# ---- group: Fill in for correct step statistics
number_of_stepper_motor_steps = Panel("200")
microstep_level = Panel("4")

# ----
preview_position_0_1_2 = Number(preview_position_0_1)

# ---- group: Can be used to reduce or increase the pinion tooth spacing
pinion_tooth_spacing_factor = Panel("-0.14")

# ---- group: Prepare properties
multiplication = Multiplication(A=milling_bit_diameter_4, B=pinion_tooth_spacing_factor)
multiplication_2 = Multiplication(A=number_of_pinion_teeth_4, B=sample_tooth_position)
division = Division(A=milling_bit_diameter_4, B=pinion_corner_tolerance_factor)
addition = Addition(A=milling_bit_diameter_4, B=multiplication)
multiplication_3 = Multiplication(A=milling_bit_diameter_4, B="0.5")
multiplication_4 = Multiplication(A=motor_shaft_diameter_4, B="0.5")
round = Round(Number=multiplication_2)  # -> Nearest, Floor, Ceiling
multiplication_5 = Multiplication(A=number_of_pinion_teeth_4, B="2")
neg = Negative(Value=division)
multiplication_6 = Multiplication(A=milling_bit_diameter_4, B=tooth_fillet_ratio_2)
milling_bit_radius = Panel(multiplication_3)
xy = XYPlane(Origin=Point(0, 0, 0))
sample_tooth_number = Panel(round.Ceiling)
multiplication_7 = Multiplication(A=addition, B=multiplication_5)
tooth_fillet_radius = Panel(multiplication_6)
pinion_circumference = Panel(multiplication_7)
cir = Circle(Plane=xy, Radius=milling_bit_radius)
pi = Pi(Factor=1)
division_2 = Division(A=pinion_circumference, B=pi)
number_of_pinion_teeth_5 = Panel(number_of_pinion_teeth_4)
pinion_diameter = Panel(division_2)
sample_tooth_number_2 = Panel(sample_tooth_number)
number_of_curve_sample_points_2 = Panel(number_of_curve_sample_points)
multiplication_8 = Multiplication(A=pinion_diameter, B="0.5")
division_3 = Division(A=sample_tooth_number_2, B=number_of_pinion_teeth_5)
pinion_radius = Panel(multiplication_8)
pinion_circumference_2 = Panel(pinion_circumference)
multiplication_9 = Multiplication(A="360", B=division_3)
Y = UnitY(Factor=pinion_radius)
division_4 = Division(A="360", B=number_of_pinion_teeth_5)
multiplication_10 = Multiplication(A=pinion_circumference_2, B=division_3)
division_5 = Division(A=multiplication_9, B=number_of_curve_sample_points_2)
division_6 = Division(A=pinion_circumference, B=number_of_pinion_teeth_4)
move = Move(Geometry=xy, Motion=Y)  # -> Geometry, Transform
series = Series(Start=0, Step=division_4, Count=number_of_pinion_teeth_5)
division_7 = Division(A=multiplication_10, B=number_of_curve_sample_points_2)
series_2 = Series(Start=0, Step=division_5, Count=number_of_curve_sample_points_2)
tooth_spacing = Panel(division_6)
rad = Radians(Degrees=series)
circle = Circle(cir)
series_3 = Series(Start=0, Step=division_7, Count=number_of_curve_sample_points_2)
neg_2 = Negative(Value=series_2)
rotate = Rotate(Geometry=circle, Angle=rad, Plane=move.Geometry)  # -> Geometry, Transform
rad_2 = Radians(Degrees=neg_2)

# ---- group: Make step resolution statisitics
number_of_stepper_motor_steps_2 = Panel(number_of_stepper_motor_steps)
microstep_level_2 = Panel(microstep_level)
division_8 = Division(A=pinion_circumference, B=number_of_stepper_motor_steps_2)
distance_covered_per_step = Panel(division_8)
division_9 = Division(A=distance_covered_per_step, B=microstep_level_2)
distance_covered_per_micro_step = Panel(division_9)

# ---- group: Step statsistics
distance_covered_per_step_2 = Panel(distance_covered_per_step)
distance_covered_per_micro_step_2 = Panel(distance_covered_per_micro_step)

# ---- group: Create rack tooth geometry
sample_tooth_number_3 = Panel(sample_tooth_number_2)
tooth_spacing_2 = Panel(tooth_spacing)
item = ListItem(List=rotate.Geometry, Index=sample_tooth_number_3, Wrap=True)
rotate_2 = Rotate(Geometry=graft(item), Angle=rad_2, Plane=move.Geometry)  # -> Geometry, Transform
tooth_spacing_3 = Panel(tooth_spacing)
X = UnitX(Factor=series_3)
sample_tooth_number_4 = Panel(sample_tooth_number_3)
milling_it_radius = Panel(multiplication_3)
subtraction = Subtraction(A=sample_tooth_number_3, B="0.5")
move_2 = Move(Geometry=rotate_2.Geometry, Motion=X)  # -> Geometry, Transform
multiplication_11 = Multiplication(A=sample_tooth_number_4, B=tooth_spacing_3)
area = Area(Geometry=move_2.Geometry)  # -> Area, Centroid
pt = ConstructPoint(XCoordinate=multiplication_11, YCoordinate=0, ZCoordinate=0)
multiplication_12 = Multiplication(A=subtraction, B=tooth_spacing_2)
multiplication_13 = Multiplication(A=sample_tooth_number_3, B=tooth_spacing_2)
deplane = DeconstructPlane(Plane=xy)  # -> Origin, XAxis, YAxis, ZAxis
merge = Merge(Data1=flatten(area.Centroid), Data2=flatten(pt))
amp = Amplitude(Vector=deplane.YAxis, Amplitude=milling_it_radius)
amp_2 = Amplitude(Vector=deplane.XAxis, Amplitude=multiplication_12)
amp_3 = Amplitude(Vector=deplane.XAxis, Amplitude=multiplication_13)
intcrv = Interpolate(Vertices=merge, Degree=3, Periodic=False, KnotStyle=1)  # -> Curve, Length, Domain
rev = Reverse(Vector=amp)
move_3 = Move(Geometry=deplane.Origin, Motion=amp_2)  # -> Geometry, Transform
move_4 = Move(Geometry=deplane.Origin, Motion=amp_3)  # -> Geometry, Transform
move_5 = Move(Geometry=move_3.Geometry, Motion=rev)  # -> Geometry, Transform
yz = YZPlane(Origin=move_5.Geometry)
crv = Curve(intcrv.Curve)
mirror = Mirror(Geometry=crv, Plane=yz)  # -> Geometry, Transform
ccx = CurveCurve(CurveA=crv, CurveB=mirror.Geometry)  # -> Points, ParamsA, ParamsB
shatter = Shatter(Curve=crv, Parameters=ccx.ParamsA)
rev_2 = ReverseList(List=shatter)
milling_it_radius_2 = Panel(milling_it_radius)
tooth_fillet_radius_2 = Panel(tooth_fillet_radius)
item_2 = ListItem(List=rev_2, Index=0, Wrap=True)
mirror_2 = Mirror(Geometry=item_2, Plane=yz)  # -> Geometry, Transform
pt_2 = Point(move_4.Geometry)
pt_3 = Point(deplane.Origin)
addition_2 = Addition(A=tooth_fillet_radius_2, B=milling_it_radius_2)
join = JoinCurves(Curves=[item_2, mirror_2.Geometry], Preserve=False)
vec2pt = Vector2Pt(PointA=pt_2, PointB=pt_3, Unitize=False)  # -> Vector, Length
fillet = Fillet(Curve=join, Radius=addition_2)
move_6 = Move(Geometry=fillet, Motion=vec2pt.Vector)  # -> Geometry, Transform

# ----
distance_covered_per_step_3 = Panel(distance_covered_per_step)
distance_covered_per_step_4 = Number(distance_covered_per_step_3)
distance_covered_per_step_5 = ClusterOutput(distance_covered_per_step_4)

# ---- group: Create and blend pinion teeth
eval = EvaluateLength(Curve=fillet, Length="0.5", Normalized=True)  # -> Point, Tangent, Parameter
pdecon = Deconstruct(Point=eval.Point)  # -> XComponent, YComponent, ZComponent
milling_it_radius_3 = Panel(milling_bit_radius)
pinion_corner_tolerance = Panel(neg)
subtraction_2 = Subtraction(A=pdecon.YComponent, B=milling_it_radius_3)
subtraction_3 = Subtraction(A=subtraction_2, B=milling_it_radius_3)
subtraction_4 = Subtraction(A=subtraction_3, B=pinion_corner_tolerance)
pt_4 = ConstructPoint(XCoordinate=0, YCoordinate=subtraction_4, ZCoordinate=0)
rounding_factor_pinion_outside_2 = Panel(rounding_factor_pinion_outside)
xy_2 = XYPlane(Origin=pt_4)
division_10 = Division(A="360", B=multiplication_5)
rounding_factor_pinion_inside_2 = Panel(rounding_factor_pinion_inside)
subtraction_5 = Subtraction(A="0", B=rounding_factor_pinion_outside_2)
addition_3 = Addition(A="180", B=rounding_factor_pinion_outside_2)
rad_3 = Radians(Degrees=addition_3)
rad_4 = Radians(Degrees=subtraction_5)
subtraction_6 = Subtraction(A="180", B=rounding_factor_pinion_inside_2)
addition_4 = Addition(A="0", B=rounding_factor_pinion_inside_2)
milling_it_radius_4 = Panel(milling_it_radius_3)
dom = ConstructDomain(DomainStart=rad_4, DomainEnd=rad_3)
xy_3 = XYPlane(Origin=Point(0, 0, 0))
rad_5 = Radians(Degrees=subtraction_6)
rad_6 = Radians(Degrees=addition_4)
dom_2 = ConstructDomain(DomainStart=rad_6, DomainEnd=rad_5)
pi_2 = Pi(Factor=1)
arc = Arc(Plane=xy_3, Radius=milling_it_radius_4, Angle=dom)  # -> Arc, Length
arc_2 = Arc(Plane=xy_2, Radius=milling_it_radius_4, Angle=dom_2)  # -> Arc, Length
rad_7 = Radians(Degrees=division_10)
rotate_3 = Rotate(Geometry=arc.Arc, Angle=pi_2, Plane=xy_3)  # -> Geometry, Transform
addition_5 = Addition(A=rad, B=rad_7)
number_slider = Slider(0.5, range=0..1)
rotate_4 = Rotate(Geometry=rotate_3.Geometry, Angle=rad, Plane=move.Geometry)  # -> Geometry, Transform
rotate_5 = Rotate(Geometry=arc_2.Arc, Angle=addition_5, Plane=move.Geometry)  # -> Geometry, Transform
flip = FlipCurve(Curve=rotate_4.Geometry)  # -> Curve, Flag
flip_2 = FlipCurve(Curve=rotate_5.Geometry)  # -> Curve, Flag
pinion_radius_2 = Panel(pinion_radius)
shift = ShiftList(List=flip.Curve, Shift=1, Wrap=True)
blendc = BlendCurve(CurveA=rotate_4.Geometry, CurveB=flip_2.Curve, BulgeA=number_slider, BulgeB=number_slider, Continuity=2)
blendc_2 = BlendCurve(CurveA=shift, CurveB=rotate_5.Geometry, BulgeA=number_slider, BulgeB=number_slider, Continuity=2)
neg_3 = Negative(Value=pinion_radius_2)
Y_2 = UnitY(Factor=neg_3)
cir_2 = Circle(Plane=move.Geometry, Radius=multiplication_4)
join_2 = JoinCurves(Curves=flatten([rotate_4.Geometry, rotate_5.Geometry, blendc, blendc_2]), Preserve=False)
move_7 = Move(Geometry=join_2, Motion=Y_2)  # -> Geometry, Transform
pinion_teeth = Curve(move_7.Geometry)

# ----
move_8 = Move(Geometry=cir_2, Motion=Y_2)  # -> Geometry, Transform

# ---- group: Create and blend pinion teeth (continued)
pinion_center_hole = Curve(move_8.Geometry)

# ---- group: Create pinion movement preview
preview_position_0_1_3 = Number(preview_position_0_1_2)
pinion_radius_3 = Panel(pinion_radius)
pinion_circumference_3 = Panel(pinion_circumference)
multiplication_14 = Multiplication(A="360", B=preview_position_0_1_3)
multiplication_15 = Multiplication(A=pinion_circumference_3, B=preview_position_0_1_3)
neg_4 = Negative(Value=multiplication_14)
X_2 = UnitX(Factor=multiplication_15)
rad_8 = Radians(Degrees=neg_4)
rotate_6 = Rotate(Geometry=flatten([join_2, cir_2]), Angle=rad_8, Plane=move.Geometry)  # -> Geometry, Transform
move_9 = Move(Geometry=rotate_6.Geometry, Motion=X_2)  # -> Geometry, Transform
neg_5 = Negative(Value=pinion_radius_3)
Y_3 = UnitY(Factor=neg_5)
move_10 = Move(Geometry=move_9.Geometry, Motion=Y_3)  # -> Geometry, Transform
pinion_movement_preview = Curve(move_10.Geometry)

# ---- group: Make pinion bit statisitics
pinion_radius_4 = Panel(pinion_radius)
rotate_7 = Rotate(Geometry=move.Geometry, Angle=4.71238898, Plane=move.Geometry)  # -> Geometry, Transform
pinion_teeth_2 = Curve(join_2)
cir_3 = Circle(Plane=rotate_7.Geometry, Radius=pinion_radius_4)
trim = TrimWithRegion(Curve=cir_3, Region=pinion_teeth_2)  # -> Inside, Outside
item_3 = ListItem(List=trim.Outside, Index=0, Wrap=True)
len = Length(Curve=flatten(item_3))
maxium_pinion_milling_bit_diamter = Panel(len)

# ----
maxium_pinion_milling_bit_diamter_2 = Panel(maxium_pinion_milling_bit_diamter)
maxium_pinion_milling_bit_diamter_3 = Number(maxium_pinion_milling_bit_diamter_2)
pinion_movement_preview_2 = Curve(pinion_movement_preview)
pinion_center_hole_2 = Curve(pinion_center_hole)
pinion_teeth_3 = Curve(pinion_teeth)
pinion_teeth_4 = ClusterOutput(pinion_teeth_3)
pinion_center_hole_3 = ClusterOutput(pinion_center_hole_2)
pinion_movement_preview_3 = ClusterOutput(pinion_movement_preview_2)
maxium_pinion_milling_bit_diamter_4 = ClusterOutput(maxium_pinion_milling_bit_diamter_3)

# ---- group: Create rack by copying and offsetting rack tooth
tooth_spacing_4 = Panel(tooth_spacing)
rack_length_5 = Panel(rack_length_4)
milling_bit_radius_2 = Panel(multiplication_3)
pinion_radius_5 = Panel(pinion_radius)
addition_6 = Addition(A=pinion_radius_5, B=milling_bit_radius_2)
multiplication_16 = Multiplication(A=addition_6, B="2")
division_11 = Division(A=addition_6, B=tooth_spacing_4)
round_2 = Round(Number=division_11)  # -> Nearest, Floor, Ceiling
multiplication_17 = Multiplication(A=round_2.Ceiling, B=tooth_spacing_4)
neg_6 = Negative(Value=multiplication_17)
rack_start_distance = Panel(neg_6)
pinion_radius_6 = Panel(pinion_radius)
neg_7 = Negative(Value=pinion_radius_6)
Y_4 = UnitY(Factor=neg_7)

# ----
addition_7 = Addition(A=rack_length_5, B=multiplication_16)
actual_rack_length = Panel(addition_7)
X_3 = UnitX(Factor=rack_start_distance)
move_11 = Move(Geometry=move_6.Geometry, Motion=X_3)  # -> Geometry, Transform

# ---- group: Create rack by copying and offsetting rack tooth (continued)
division_12 = Division(A=actual_rack_length, B=tooth_spacing_4)
round_3 = Round(Number=division_12)  # -> Nearest, Floor, Ceiling
addition_8 = Addition(A=round_3.Ceiling, B="1")
series_4 = Series(Start=0, Step=tooth_spacing_4, Count=addition_8)
X_4 = UnitX(Factor=series_4)
move_12 = Move(Geometry=move_11.Geometry, Motion=X_4)  # -> Geometry, Transform
join_3 = JoinCurves(Curves=move_12.Geometry, Preserve=False)
offset = Offset(Curve=join_3, Distance=milling_it_radius, Plane=PlaneXY(0, 0, 0), Corners=2)
move_13 = Move(Geometry=offset, Motion=Y_4)  # -> Geometry, Transform
rack_toolpath = Curve(join_3)

# ----
rack_teeth = Curve(move_13.Geometry)
preview = CustomPreview(Geometry=rack_toolpath, Shader=ColourSwatch(SwatchColor=RGB(48, 112, 110)))

milling_bit_radius_3 = Panel(multiplication_3)
pinion_radius_7 = Panel(pinion_radius)
addition_9 = Addition(A=pinion_radius_7, B=milling_bit_radius_3)
cir_4 = Circle(Plane=move.Geometry, Radius=addition_9)

move_14 = Move(Geometry=cir_4, Motion=Y_2)  # -> Geometry, Transform

pinion_edge = Curve(move_14.Geometry)

pinion_edge_2 = Curve(pinion_edge)
pinion_edge_3 = ClusterOutput(pinion_edge_2)

# ---- group: Trim rack to specified length
rack_start_distance_2 = Panel(rack_start_distance)
actual_rack_length_2 = Panel(actual_rack_length)
pinion_diameter_2 = Panel(pinion_diameter)
rack_teeth_2 = Curve(rack_teeth)
neg_8 = Negative(Value=pinion_diameter_2)

# ----
pt_5 = ConstructPoint(XCoordinate=rack_start_distance_2, YCoordinate=0, ZCoordinate=0)

# ---- group: Trim rack to specified length (continued)
xy_4 = XYPlane(Origin=pt_5)
rectangle = Rectangle(Plane=xy_4, XSize=actual_rack_length_2, YSize=neg_8, Radius=0)  # -> Rectangle, Length
trim_2 = TrimWithRegion(Curve=rack_teeth_2, Region=rectangle.Rectangle)  # -> Inside, Outside
bbox = BoundingBox(Content=trim_2.Inside, Plane=PlaneXY(0, 0, 0))  # -> Box, Box_2
edges = BrepEdges(Brep=bbox.Box)  # -> Naked, Interior, NonManifold
item_4 = ListItem(List=edges.Naked, Index="2", Wrap=True)
flip_3 = FlipCurve(Curve=item_4)  # -> Curve, Flag
rack_tooth_edge = Curve(flip_3.Curve)
trimmed_rack_teeth = Curve(trim_2.Inside)

# ----
rack_teeth_3 = Curve(trimmed_rack_teeth)
rack_edge = Curve(rack_tooth_edge)
rack_teeth_4 = ClusterOutput(rack_teeth_3)
rack_edge_2 = ClusterOutput(rack_edge)

# ==== cluster DivideCurveEvenLenght: Calculates approximate curve length for even division
crv = ClusterInput()
crv_2 = Curve(crv)
B = ClusterInput()
len = Length(Curve=crv_2)
division = Division(A=len, B=B)
int = Integer(division)
divide = DivideCurve(Curve=crv_2, Count=int, Kinks=False)  # -> Points, Tangents, Parameters
P = ClusterOutput(divide.Points)
